# Dynamo graph Door_Auditing_Automation.dyn (Dynamo 3.6.2.11575)

categories = Categories("OST_Doors")
all_elements_of_category = ElementsOfCategory(Category=categories)
code_block = CodeBlock { "Audited_By"; }
getParameterValueByName = Element.GetParameterValueByName(element=all_elements_of_category, parameterName=code_block)
code_block_2 = CodeBlock { "Raghav Karol"; }
setParameterByName = Element.SetParameterByName(element=all_elements_of_category, parameterName=code_block, value=code_block_2)
