# Dynamo graph Fire_Rating_Status.dyn (Dynamo 3.6.2.11575)

categories = Categories("OST_Doors")
all_elements_of_category = ElementsOfCategory(Category=categories)
elementType = Element.ElementType(element=all_elements_of_category)
code_block = CodeBlock { "Width"; }
getParameterValueByName = Element.GetParameterValueByName(element=elementType, parameterName=code_block)
code_block_2 = CodeBlock(x=getParameterValueByName) { x == null || x== ""? 0 : x; }
code_block_3 = CodeBlock { 3.5; }
lt = code_block_2 < code_block_3
filterByBoolMask = List.FilterByBoolMask(list=all_elements_of_category, mask=lt)
code_block_4 = CodeBlock { "Fire_Rating_Status"; }
code_block_5 = CodeBlock { "Standard Door - Pass"; }
setParameterByName = Element.SetParameterByName(element=filterByBoolMask.in, parameterName=code_block_4, value=code_block_5)
code_block_6 = CodeBlock { "Oversized - Requires Review"; }
setParameterByName_2 = Element.SetParameterByName(element=filterByBoolMask.out, parameterName=code_block_4, value=code_block_6)
